# Grasshopper definition Hops_Test.gh (Grasshopper 1.0.7)
# plug-ins: Hops

data = Data("C:\Users\REN\Downloads\dataObject.json")
python = GhPythonScript(x=data)  # -> out, lineType, vertices, corridor, levels
# ---------- python: Python ----------
__author__ = "REN"
__version__ = "2023.08.24"

import rhinoscriptsyntax as rs
import json

with open(x, 'r') as file:
    data = json.load(file)
print(data)

#print(data["geometry"]["type"])
#print(data["geometry"]["coordinates"])
#print(data["properties"]["corridorType"])
#print(data["properties"]["floorsInput"])

lineType = data["geometry"]["type"]
vertices = data["geometry"]["coordinates"]
corridor = data["properties"]["corridorType"]
levels = data["properties"]["floorsInput"]
# ---------- end python ----------
c_script = CSharpScript(x=python.vertices)  # -> out, simplify(A)
# ---------- c_script: C# ----------
    A = x;
# ---------- end c_script ----------
path = FilePath("C:\git\IAAC\thesis\assets\FloorPlanGenerator_Combined.gh")
panel = Panel(path)
hops = Hops(
    _Path=path,
    LineType=python.lineType,
    Vertices=c_script.A,
    Corridor=python.corridor,
    Levels=python.levels,
    CacheResultsInMemory=True,
    CacheSolveResults=True,
    RemoteDefinitionLocation="C:\git\IAAC\thesis\assets\FloorPlanGenerator_Combined.gh",
    RemoteSolveVersion=(0, 1, 0),
    ShowInput_Enabled=False,
    ShowInput_Path=True,
    SynchronousSolve=True)
