# Grasshopper definition intake.gh (Grasshopper 1.0.7)
# plug-ins: Wombat

defaultvalue = Panel("Polygon")
defaultvalue_2 = Panel("double loaded")
corridorwidth_m = Slider(2.5, range=0..2.5)
buildingdepth_m = Slider(25, range=0..100)
randomreduceby = Slider(5, range=0..10)
floorheight = Slider(4, range=2.2..4)

# ---- group: RH_IN:lineType
txt = Text(defaultvalue)

# ---- group: RH_IN:corridor
data = Data(defaultvalue_2)

# ----
# Linear or Courtyard
# (LineString or Polygon)
panel = Panel("Polygon")
tmatch = MatchText(Text=txt, RegEx=panel, Case=True)
filter = StreamFilter(Gate=tmatch, Stream0="0", Stream1="2")
typology = Number(filter)

# ----
# Single or Double Corridor
panel_2 = Panel("double loaded")
tmatch_2 = MatchText(Text=data, RegEx=panel_2, Case=True)
filter_2 = StreamFilter(Gate=tmatch_2, Stream0="0", Stream1="1")
corridor = Number(filter_2)

writepythonfiles = Text("False")

# ----
# Levels
defaultvalue_3 = Panel("2")
buildingdepth_m_2 = Number(buildingdepth_m)
corridorwidth_m_2 = Number(corridorwidth_m)
randcombinerooms = Number(randomreduceby)
floor_height = Number(floorheight)

# ---- group: RH_IN:levels
data_2 = Data(defaultvalue_3)

# ----
levels = Number(data_2)
division = Division(A=buildingdepth_m_2, B=2)
division_2 = Division(A=corridorwidth_m_2, B=2)
defaultpts = Data(Tree({0;0;0}: [-43.78647637, 36.29287099], {0;0;1}: [79.60457781, 45.09542952], {0;0;2}: [40.42267925, -46.10201195], {0;0;3}: [-76.24078068, -37.29945342]))
_0_5_buildingdepth_m = Number(division)
_0_5corridordepth_m = Number(division_2)

# ---- group: RH_IN:vertices
data_3 = Data(defaultpts)

# ----
addition = Addition(A=typology, B=corridor)

flip = FlipMatrix(Data=data_3)
bang = ExplodeTree(Data=flip)  # -> Branch0, Branch1
pt = ConstructPoint(XCoordinate=bang.Branch0, YCoordinate=bang.Branch1, ZCoordinate=0)

type = Number(addition)
# COURTYARD
_0_5_corridordepth_m = Number(_0_5corridordepth_m)
pline = PolyLine(Vertices=pt, Closed=True)
# LINEAR
pline_2 = PolyLine(Vertices=pt, Closed=False)
centerline = Geometry(pline_2)
neg = Negative(Value=_0_5_corridordepth_m)
offset = OffsetCurve(Curve=pline, Distance=[_0_5_corridordepth_m, neg], Corners=1)  # -> flatten(Curve)
offset_2 = OffsetCurve(Curve=centerline, Distance=[_0_5_corridordepth_m, neg], Corners=1)  # -> flatten(Curve)
_0_5_buildingdepth_m_2 = Number(_0_5_buildingdepth_m)
item = ListItem(List=offset_2, Index=0, Wrap=True)  # -> Item, Item1
item_2 = ListItem(List=offset, Index=0, Wrap=True)  # -> Item, Item1
loft = Loft(Curves=offset_2, Options={Adjust=False, Closed=False, LoftEnds=0, LoftSimp=0, LoftType=0, Rebuild=10, Refit=0.01})
loft_2 = Loft(Curves=offset_2, Options={Adjust=False, Closed=False, LoftEnds=0, LoftSimp=0, LoftType=0, Rebuild=10, Refit=0.01})
boundary = BoundarySurfaces(Edges=offset)
boundary_2 = BoundarySurfaces(Edges=offset)
neg_2 = Negative(Value=_0_5_buildingdepth_m_2)

# ---- group: centerline
type_2 = Number(type)
filter_3 = StreamFilter(Gate=type_2, Stream0=centerline, Stream1=centerline, Stream2=pline, Stream3=pline)

# ---- group: corridor
type_3 = Number(type)
filter_4 = StreamFilter(Gate=type_3, Stream0=offset_2, Stream1=offset_2, Stream2=offset, Stream3=offset)

type_4 = Number(type)
filter_5 = StreamFilter(Gate=type_4, Stream0=loft, Stream1=loft_2, Stream2=boundary, Stream3=boundary_2)

# ----
offset_3 = OffsetCurve(Curve=item.Item, Distance=_0_5_buildingdepth_m_2, Corners=1)  # -> flatten(Curve)
offset_4 = OffsetCurve(Curve=item.Item1, Distance=neg_2, Corners=1)  # -> flatten(Curve)
offset_5 = OffsetCurve(Curve=item_2.Item, Distance=_0_5_buildingdepth_m_2, Corners=1)  # -> flatten(Curve)
offset_6 = OffsetCurve(Curve=item_2.Item1, Distance=neg_2, Corners=1)  # -> flatten(Curve)
merge = Merge(Data1=offset_5, Data2=offset_6)
loft_3 = Loft(
    Curves=[offset_3, item.Item],
    Options={Adjust=False, Closed=False, LoftEnds=0, LoftSimp=0, LoftType=0, Rebuild=10, Refit=0.01})
loft_4 = Loft(
    Curves=[offset_4, item.Item1],
    Options={Adjust=False, Closed=False, LoftEnds=0, LoftSimp=0, LoftType=0, Rebuild=10, Refit=0.01})
boundary_3 = BoundarySurfaces(Edges=[item_2.Item, offset_5])
merge_2 = Merge(Data1=offset_3, Data2=offset_4)
boundary_4 = BoundarySurfaces(Edges=[offset_6, item_2.Item1])
crv = Curve(offset_5)
crv_2 = Curve(offset_3)

# ---- group: buildingOutlineCrv
type_5 = Number(type)
filter_6 = StreamFilter(Gate=type_5, Stream0=crv_2, Stream1=merge_2, Stream2=crv, Stream3=merge)

# ---- group: buildingOutlineSrf
type_6 = Number(type)
filter_7 = StreamFilter(Gate=type_6, Stream0=loft_3, Stream1=[loft_4, loft_3], Stream2=boundary_3, Stream3=[boundary_4, boundary_3])

# ----
debrep = DeconstructBrep(Brep=filter_7)  # -> Faces, Edges, Vertices
divdist = DivideDistance(Curve=filter_3, Distance="5")  # -> Points, Tangents, Parameters
join = JoinCurves(Curves=debrep.Edges, Preserve=False)
panel_3 = Panel("""0
-1""")
cull_i = CullIndex(List=divdist.Points, Indices=panel_3, Wrap=True)
pull = PullPoint(Point=cull_i, Geometry=graft(filter_6), ClosestOnly=True)  # -> ClosestPoint, Distance
ln = Line(StartPoint=cull_i, EndPoint=pull.ClosestPoint)

# ----
# Random Reduce
# Make Larger Rooms
courtyardrandreduce = Slider(5, range=0..10)
linearrandreduce = Slider(32, range=0..100)
split = SplitWithBrep(Curve=simplify(ln), Brep=filter_5)  # -> Curve, Points
division_3 = Division(A=linearrandreduce, B="2")
type_7 = Number(type)
filter_8 = StreamFilter(Gate=type_7, Stream0=division_3, Stream1=division_3, Stream2=courtyardrandreduce, Stream3=courtyardrandreduce)
item_3 = ListItem(List=split.Curve, Index="1", Wrap=True)
reduce = RandomReduce(List=flatten(item_3), Reduction=filter_8, Seed=1)

# ----
# Clean Up Corners
end = EndPoints(Curve=reduce)  # -> Start, End
cullpt = CullDuplicates(Points=end.End, Tolerance=0.1, CullMode=3)  # -> Points, Indices, Valence
item_4 = ListItem(List=reduce, Index=cullpt.Indices, Wrap=True)

# ----
# demisingCrvs
building_boundary_srf = Surface(filter_7)

# ---- group: Corridor Curves
crv_3 = Curve(flatten(filter_4))

# ---- group: Demising
crv_4 = Curve(item_4)

# ----
merge_3 = Merge(Data1=crv_4, Data2=crv_3)  # -> flatten(Result)

# ----
# Sort out Corridor
midpt = CurveMiddle(Curve=filter_3)
srfsplit = SurfaceSplit(Surface=building_boundary_srf, Curves=merge_3)
srf_cp = SurfaceClosestPoint(Point=midpt, Surface=srfsplit)  # -> Point, UVPoint, Distance
smaller = SmallerThan(FirstNumber=srf_cp.Distance, SecondNumber="1e-5")  # -> SmallerThan, OrEqualTo
dispatch = Dispatch(List=srfsplit, DispatchPattern=smaller.SmallerThan)  # -> ListA, ListB

len = Length(Curve=filter_3)
division_4 = Division(A=len, B="120")
round = Round(Number=division_4)  # -> Nearest, Floor, Ceiling
divide = DivideCurve(Curve=filter_3, Count=round.Ceiling, Kinks=False)  # -> Points, Tangents, Parameters

corridor_2 = Number(corridor)
# egressNodes
number_slider = Slider(4, range=0..10)
typology_2 = Number(typology)
levels_2 = Number(levels)
series = Series(Start=number_slider, Step=number_slider, Count=levels_2)  # -> flatten(Series)
unit_z = UnitZ(Factor=series)  # -> simplify(graft(UnitVector))
negative = Negative(Value=number_slider)

# ----
# Sort Surfaces Along Corridor Center Curve
area = Area(Geometry=dispatch.ListB)  # -> Area, Centroid
pull_2 = PullPoint(Point=area.Centroid, Geometry=filter_3, ClosestOnly=True)  # -> ClosestPoint, Distance

# ---- group: corridor Nodes
# corridorNodes
alongcrv = SortAlongCurve(Points=pull_2.ClosestPoint, Curve=filter_3)  # -> Points, Indices

# ----
mindex = MemberIndex(Set=pull_2.ClosestPoint, Member=alongcrv.Points)  # -> Index, Count
cset = CreateSet(List=flatten(mindex.Index))  # -> Set, Map
item_5 = ListItem(List=dispatch.ListB, Index=cset.Set, Wrap=True)

corridor_nodes = Point(alongcrv.Points)

# ---- group: Corridor edges
# Corridor Edges
explode = Explode(Curve=filter_3, Recursive=True)  # -> Segments, Vertices
cull_duplicates = CullDuplicates(Points=corridor_nodes, Tolerance=0.1, CullMode=3)  # -> flatten(Points), Indices, Valence
cull_duplicates_2 = CullDuplicates(Points=corridor_nodes, Tolerance=0.1, CullMode=3)  # -> Points, Indices, Valence
point = Point([explode.Vertices, cull_duplicates_2.Points])
curve_closest_point = CurveClosestPoint(Point=flatten(point), Curve=filter_3)  # -> Point, Parameter, Distance
shatter = Shatter(Curve=filter_3, Parameters=curve_closest_point.Parameter)
end_points = EndPoints(Curve=shatter)  # -> Start, End
point_2 = Point([end_points.Start, end_points.End])
cull_duplicates_3 = CullDuplicates(Points=point_2, Tolerance=0.1, CullMode=3)  # -> Points, Indices, Valence
filter_9 = StreamFilter(Gate=corridor_2, Stream0=cull_duplicates.Points, Stream1=cull_duplicates_3.Points)
data_4 = Data(flatten(filter_9))
shift_list = ShiftList(List=data_4, Shift=1, Wrap=True)
cull_index = CullIndex(List=shift_list, Indices="-1", Wrap=True)
dispatch_2 = Dispatch(List=cull_index, DispatchPattern=[True, False])  # -> ListA, ListB
dispatch_3 = Dispatch(List=data_4, DispatchPattern=[True, False])  # -> ListA, ListB
point_3 = Point(dispatch_3.ListB)
# roomNodes
point_4 = Point(dispatch_2.ListB)
point_5 = Point(dispatch_3.ListA)
point_6 = Point(dispatch_2.ListA)
line = Line(StartPoint=point_5, EndPoint=point_3)
line_2 = Line(StartPoint=point_6, EndPoint=point_4)
weave = Weave(Pattern=[0, 1], Stream0=line, Stream1=line_2, NullGaps=False)

# ----
# Find Room Closest to Egress Points
geo = Geometry(item_5)
area_2 = Area(Geometry=geo)  # -> Area, Centroid
dist = Distance(PointA=area_2.Centroid, PointB=graft(divide.Points))
sort = SortList(Keys=dist, ValuesA=geo)  # -> Keys, ValuesA
cull_i_2 = CullIndex(List=sort.ValuesA, Indices="0", Wrap=True)  # -> flatten(List)

# ---- group: Egress
item_6 = ListItem(List=sort.ValuesA, Index=0, Wrap=True)  # -> flatten(Item)

# ----
area_3 = Area(Geometry=cull_i_2)  # -> Area, Centroid

# ---- group: Egress Nodes
area_4 = Area(Geometry=item_6)  # -> Area, Centroid

# ----
cset_2 = CreateSet(List=area_3.Centroid)  # -> Set, Map
mindex_2 = MemberIndex(Set=cset_2.Set, Member=area_4.Centroid)  # -> Index, Count

filter_10 = StreamFilter(Gate=typology_2, Stream0=cull_index, Stream2=shift_list)

# ---- group: roomNodes
cull_i_3 = CullIndex(List=cset_2.Set, Indices=flatten(mindex_2.Index), Wrap=True)

# ----
# corridorEdges
corridoredges = Curve(weave)

cp = ClosestPoint(Point=cull_i_3, Cloud=flatten(corridor_nodes))  # -> ClosestPoint, CPIndex, Distance

# ---- group: Rooms Egdes
# roomEdges
line_3 = Line(StartPoint=cull_i_3, EndPoint=cp.ClosestPoint)

# ---- group: Egress nodes
move = Move(Geometry=flatten(item_6), Motion=unit_z)  # -> Geometry, Transform
data_5 = Data([item_6, move.Geometry])
area_5 = Area(Geometry=data_5)  # -> Area, Centroid

# ----
data_6 = Data(flatten(line_3))

cp_2 = ClosestPoint(Point=area_4.Centroid, Cloud=flatten(data_4))  # -> ClosestPoint, CPIndex, Distance
pt_2 = Point(cp_2.ClosestPoint)
line_4 = Line(StartPoint=area_4.Centroid, EndPoint=cp_2.ClosestPoint)
point_list = PointList(Points=pt_2)
pt_3 = Point(area_4.Centroid)
# egressNodes
move_2 = Move(Geometry=flatten(pt_3), Motion=unit_z)  # -> Geometry, Transform
move_3 = Move(Geometry=flatten(line_4), Motion=unit_z)  # -> Geometry, Transform
merge_4 = Merge(Data1=flatten(pt_3), Data2=flatten(move_2.Geometry))
merge_5 = Merge(Data1=flatten(line_4), Data2=flatten(move_3.Geometry))
lng = ListLength(List=pt_3)
lng_2 = ListLength(List=line_4)

# ---- group: Room Nodes
move_4 = Move(Geometry=flatten(cull_i_3), Motion=unit_z)  # -> Geometry, Transform

# ---- group: Corridor nodes
move_5 = Move(Geometry=flatten(data_4), Motion=unit_z)  # -> Geometry, Transform

# ---- group: Room Edges
move_6 = Move(Geometry=flatten(data_6), Motion=unit_z)  # -> Geometry, Transform

# ---- group: Corridor Edges
move_7 = Move(Geometry=flatten(corridoredges), Motion=unit_z)  # -> Geometry, Transform

# ---- group: egressNodes
area_6 = Area(Geometry=move.Geometry)  # -> Area, Centroid

# ----
data_7 = Data([move_7.Geometry, corridoredges])
data_8 = Data([data_6, move_6.Geometry])

merge_6 = Merge(Data1=flatten(corridoredges), Data2=flatten(move_7.Geometry))
merge_7 = Merge(Data1=cull_i_3, Data2=flatten(move_4.Geometry))
merge_8 = Merge(Data1=data_4, Data2=flatten(move_5.Geometry))
merge_9 = Merge(Data1=data_6, Data2=flatten(move_6.Geometry))
lng_3 = ListLength(List=corridoredges)
lng_4 = ListLength(List=data_6)
lng_5 = ListLength(List=cull_i_3)
lng_6 = ListLength(List=data_4)

# ---- group: verticalEgress
line_sdl = LineSDL(Start=area_6.Centroid, Direction=Vector(0, 0, 1), Length=negative)

# ---- group: Corridor Edges Per Level
partition = PartitionList(List=merge_6, Size=lng_3)  # -> simplify(Chunks)

# ---- group: Room Nodes Per Level
partition_2 = PartitionList(List=merge_7, Size=lng_5)

# ---- group: Egress Nodes Per Level
partition_3 = PartitionList(List=merge_4, Size=lng)  # -> simplify(Chunks)

# ---- group: Egress Edges Per Level
partition_4 = PartitionList(List=merge_5, Size=lng_2)  # -> simplify(Chunks)

# ---- group: Room Edges Per Level
partition_5 = PartitionList(List=merge_9, Size=lng_4)

# ---- group: Corridor Nodes Per Level
partition_6 = PartitionList(List=merge_8, Size=lng_6)

# ----
removedupcrv = RemoveDupCrv(relay=partition)
removedupcrv_2 = RemoveDupCrv(relay=partition_4)
removedupcrv_3 = RemoveDupCrv(relay=line_sdl)
removedupcrv_4 = RemoveDupCrv(relay=data_8)
removedupcrv_5 = RemoveDupCrv(relay=data_7)
cullpt_2 = CullDuplicates(Points=partition_6, Tolerance=0.1, CullMode=3)  # -> Points, Indices, Valence
# removeDup
cullpt_3 = CullDuplicates(Points=partition_3, Tolerance=0.1, CullMode=3)  # -> Points, Indices, Valence
cullpt_4 = CullDuplicates(Points=partition_2, Tolerance=0.1, CullMode=3)  # -> Points, Indices, Valence

# ---- group: Corridor Weight
length = Length(Curve=removedupcrv)

# ---- group: All EgressEdges
crv_5 = Curve(flatten([removedupcrv_3, removedupcrv_2]))

# ----
data_9 = Data([removedupcrv_5, removedupcrv_4, removedupcrv_3, removedupcrv_2])
list_length = ListLength(List=flatten(cullpt_3.Points))
merge_10 = Merge(Data1=flatten(cullpt_4.Points), Data2=flatten(cullpt_3.Points), Data3=flatten(cullpt_2.Points))
list_length_2 = ListLength(List=flatten(cullpt_4.Points))
list_length_3 = ListLength(List=flatten(cullpt_2.Points))
item_index = ItemIndex(List=merge_10, Item=merge_10)
point_list_2 = PointList(Points=merge_10)
deconstruct = Deconstruct(Point=merge_10)  # -> XComponent, YComponent, ZComponent
collision_one_many = CollisionOneMany(Collider=flatten(data_9), Obstacles=graft(merge_10))  # -> Collision, Index

# ---- group: LIST LENGTH FOR EACH EDGE CATEGORY
merge_11 = Merge(Data1=list_length_2, Data2=list_length, Data3=list_length_3)

# ----
mass_addition = MassAddition(Input=collision_one_many.Collision)  # -> flatten(Result), PartialResults

# ---- group: Room Nodes
point_7 = Point(flatten(cullpt_4.Points))

# ---- group: Corridor Nodes
point_8 = Point(flatten(cullpt_2.Points))

# ---- group: Egress Edge Weights
len_2 = Length(Curve=flatten(crv_5))

# ---- group: Corridor Weight
num = Number(flatten(length))

# ----
# Nodes
# CSV Output
# Edges
panel_4 = Panel("CORRIDOR")  # disabled
panel_5 = Panel("EGRESS")  # disabled
panel_6 = Panel("UNIT")  # disabled
duplicate_data = DuplicateData(Data=panel_6, Number=list_length_2, Order=True)  # disabled
duplicate_data_2 = DuplicateData(Data=panel_5, Number=list_length, Order=True)  # disabled
duplicate_data_3 = DuplicateData(Data=panel_4, Number=list_length_3, Order=True)  # disabled
panel_7 = Panel("{0:0000}")  # disabled
seed = Number()  # disabled
format = Format(Format=panel_7, Culture=127, Data0=seed)  # disabled
path = FilePath("D:\IAAC\04_Thesis\002_Model\csv\")  # disabled
panel_8 = Panel(".csv")  # disabled
panel_9 = Panel("T01Nodes")  # disabled
panel_10 = Panel("T01Edges")  # disabled
concat = Concatenate(FragmentA=path, FragmentB=panel_9, FragmentC=format, FragmentD=panel_8)  # disabled
concat_2 = Concatenate(FragmentA=path, FragmentB=panel_10, FragmentC=format, FragmentD=panel_8)  # disabled
panel_11 = Panel(concat_2)  # disabled
boolean_toggle = Text(writepythonfiles)
boolean_toggle_2 = Text(writepythonfiles)

# ---- group: Node Names / Labels
merge_12 = Merge(Data1=duplicate_data, Data2=duplicate_data_2, Data3=duplicate_data_3)  # disabled

# ----
partition_7 = PartitionList(List=item_index, Size=merge_11)
bang_2 = ExplodeTree(Data=simplify(partition_7))  # -> Branch0, Branch1, Branch2
cp_3 = ClosestPoint(Point=point_7, Cloud=point_8)  # -> ClosestPoint, CPIndex, Distance
ln_2 = Line(StartPoint=point_7, EndPoint=cp_3.ClosestPoint)

# ---- group: Room Node ID
data_10 = Data(bang_2.Branch0)

# ---- group: Corridor Node ID
data_11 = Data(bang_2.Branch2)

# ----
item_7 = ListItem(List=data_11, Index=cp_3.CPIndex, Wrap=True)  # disabled

merge_13 = Merge(Data1=flatten(ln_2), Data2=flatten(crv_5), Data3=flatten(removedupcrv))
end_2 = EndPoints(Curve=merge_13)  # -> Start, End
entwine = Entwine(Branch00=end_2.Start, Branch01=end_2.End, FlattenInputs=True)
flip_2 = FlipMatrix(Data=entwine)  # -> simplify(Data)
pdecon = Deconstruct(Point=flip_2)  # -> XComponent, YComponent, ZComponent
pdecon_2 = Deconstruct(Point=merge_10)  # -> XComponent, YComponent, ZComponent
python = GhPythonScript(
    vx=pdecon.XComponent,
    vy=pdecon.YComponent,
    vz=pdecon.ZComponent,
    x=pdecon_2.XComponent,
    y=pdecon_2.YComponent,
    z=pdecon_2.ZComponent)  # -> out, simplify(edge_verticies); inputs vx: tree, vy: tree, vz: tree, x: list, y: list, z: list
# ---------- python: Python ----------
import rhinoscriptsyntax as rs
import Rhino.Geometry as rg
import ghpythonlib.treehelpers as th
import Rhino.RhinoMath as rm

vx=th.tree_to_list(vx,None)
vy=th.tree_to_list(vy,None)
vz=th.tree_to_list(vz,None)

epsilon=0.0000000001
edge_verticies=[]
for i in range(len(vx)):
    for j in range(len(x)):
        if rm.EpsilonEquals(vx[i][0],x[j],epsilon) and rm.EpsilonEquals(vy[i][0],y[j],epsilon) and rm.EpsilonEquals(vz[i][0],z[j],epsilon):
            first_node=j
        else:
            pass
        if rm.EpsilonEquals(vx[i][1],x[j],epsilon) and rm.EpsilonEquals(vy[i][1],y[j],epsilon) and rm.EpsilonEquals(vz[i][1],z[j],epsilon):
            second_node=j
        else:
            pass
    edge_verticies.append([first_node,second_node])
    
edge_verticies=th.list_to_tree(edge_verticies)
# ---------- end python ----------
panel_12 = Panel(pdecon.YComponent)

# ---- group: Room To Corridor Edge Length / Weight
len_3 = Length(Curve=ln_2)

# ---- group: Weights
merge_14 = Merge(Data1=flatten(len_3), Data2=flatten(len_2), Data3=flatten(num))  # -> simplify(graft(Result))

# ----
merge_15 = Merge(Data1=simplify(graft(item_index)), Data2=simplify(graft(merge_12)), Data3=simplify(graft(mass_addition.Result)))  # disabled
python_2 = GhPythonScript(write=boolean_toggle, v=python.edge_verticies, path=concat_2, features_1=flatten(merge_14))  # -> out, a; inputs write: Boolean, v: tree of Int32, features_1: list
# ---------- python_2: Python ----------
import rhinoscriptsyntax as rs
import Rhino.Geometry as rg
import csv
import ghpythonlib.treehelpers as th

v=th.tree_to_list(v,None)

if write:
    with open(path, 'wb') as file:
        writer = csv.writer(file)
        writer.writerow(['vi','vj','feature_1'])
        for i in range(len(v)):
           writer.writerow([v[i][0], v[i][1], features_1[i]])
        file.close
# ---------- end python_2 ----------
python_3 = GhPythonScript(
    write=boolean_toggle_2,
    x=deconstruct.XComponent,
    y=deconstruct.YComponent,
    z=deconstruct.ZComponent,
    path=concat,
    features=merge_15)  # -> out, a; inputs write: Boolean, x: list, y: list, z: list, features: tree
# ---------- python_3: Python ----------
import rhinoscriptsyntax as rs
import Rhino.Geometry as rg
import csv
import ghpythonlib.treehelpers as th

if write:
    features=th.tree_to_list(features,None)
    
    with open(path, 'wb') as file:
        writer = csv.writer(file)
        writer.writerow(['x','y','z','id','label','degree'])
        for i in range(len(x)):
           writer.writerow([x[i], y[i], z[i], features[i][0],features[i][1],features[i][2]])
        file.close
# ---------- end python_3 ----------

lng_7 = ListLength(List=len_2)
lng_8 = ListLength(List=merge_14)

panel_13 = Panel(python.edge_verticies)

# ----
# OUTPUT
python_4 = GhPythonScript(
    x=flatten(deconstruct.XComponent),
    y=flatten(deconstruct.YComponent),
    z=flatten(deconstruct.ZComponent),
    nodeDegree=flatten(mass_addition.Result),
    v=python.edge_verticies,
    edgeFeatures=flatten(merge_14))  # -> out, output, flatten(json_string); inputs x: list, y: list, z: list, nodeDegree: list, v: tree, edgeFeatures: list
# ---------- python_4: Python ----------
__author__ = "REN"
__version__ = "2023.08.19"

import rhinoscriptsyntax as rs
import ghpythonlib.treehelpers as th
import json

data_dict = {}
edge_dict = {}
node_dict = {}
edge_array = []
node_array = []

#if not isinstance(v, list):  # replace type_expected_for_tree with the expected type
#    print("v is not a tree!")
#else:
v = th.tree_to_list(v, None)
# edgeFeatures = th.tree_to_list(edgeFeatures, None)
c = 0

for i in range(len(v)):
    edge_dict = {
        "edge": {
            "type": "object",
            "additionalProperties": False,
            "properties": {
                "id": c,
                "source": v[i][0],
                "target": v[i][1],
                "metadata": {
                    "length": edgeFeatures[i]
                }
            }
        }
    }
    edge_array.append(edge_dict)
    c+=1

c = 0
for i in range(len(x)):
    node_dict = {
        "node": {
            "type": "object",
            "properties": {
                "label": c,
                "degree": nodeDegree[i],
                "metadata": {
                    "type": "Feature",
                    "geometry": {
                        "type": "Point",
                        "coordinates": [x[i], y[i], z[i]]
                    }
                }
            }
        }
    }
    node_array.append(node_dict)
    c+=1

data_dict = {"title": "Graph Start",
"type": "FeatureCollection",
"features": node_array + edge_array
}

output = str(data_dict)
json_string = json.dumps(data_dict)
# ---------- end python_4 ----------

bnd = Bounds(Numbers=flatten(python.edge_verticies))

# ----
# manualOutput.JSON
toggle = BooleanToggle(False)
path_2 = FilePath("D:\IAAC\04_Thesis\git-calculatorapp-frontend\backendJames\assets\manualOutput.JSON")
writetxt = WriteToTextFile(Run=toggle, TextToWrite=python_4.json_string, FilePath=path_2, Append=False, NewOnly=False)

# ---- group: RH_OUT:output
data_12 = Data(python_4.output)

# ==== cluster RemoveDupCrv
relay = ClusterInput()
midpt = CurveMiddle(Curve=relay)
cullpt = CullDuplicates(Points=midpt, Tolerance=0.1, CullMode=3)  # -> Points, Indices, Valence
item = ListItem(List=relay, Index=cullpt.Indices, Wrap=True)
end = EndPoints(Curve=item)  # -> Start, End
ln = Line(StartPoint=end.Start, EndPoint=end.End)
L = ClusterOutput(ln)
