# Grasshopper definition Hops.gh (Grasshopper 1.0.7)
# plug-ins: Hops, Wombat

panel = Panel("-0.11184793164673289, 74.60257040837084, 6.1516362405703084, -80.64235871729441")
# 1. Data conversion failed from Text to Number: component "Construct Point" (d716b5f0-8474-45cb-a1d7-fd31eea4675c)
comb = FilePath("D:\IAAC\04_Thesis\backend-copy\assets\FloorPlanGenerator_Combined.gh")
Y = Data([36.29287099, 45.09542952, -46.10201195, -37.29945342])
panel_2 = Panel(Y)
X = Data([-43.78647637, 79.60457781, 40.42267925, -76.24078068])
split = TextSplit(Text="-43,79,40,-76", Separators=",")
hops = Hops(
    _Path=comb,
    LineType="Polygon",
    Corridor="1",
    Levels="2",
    X=X,
    Y=Y,
    CacheResultsInMemory=True,
    CacheSolveResults=True,
    RemoteDefinitionLocation="D:\IAAC\04_Thesis\backend-copy\assets\FloorPlanGenerator_Combined.gh",
    RemoteSolveVersion=(0, 1, 0),
    ShowInput_Enabled=False,
    ShowInput_Path=True,
    SynchronousSolve=True)  # -> Consolelog, Output
num = Number(split)
panel_3 = Panel(num)

# ----
# JSONhops.txt
toggle = BooleanToggle(False)
path = FilePath("D:\IAAC\04_Thesis\CloudBasedGraphMachineLearningFrontend\backup\JSONhops.txt")
writetxt = WriteToTextFile(Run=toggle, TextToWrite=hops.Output, FilePath=path, Append=False, NewOnly=False)
