# Grasshopper definition loadJSON.gh (Grasshopper 1.0.7)
# plug-ins: ShapeDiverForGrasshopper

path = FilePath("D:\IAAC\04_Thesis\test,.txt")
file = ReadFile(File=path, PerLineParse=False)
parsejson = ParseJSON(JSON=file)
accessjson = AccessJSON(Object=parsejson, AddressString="features")
accessjson_2 = AccessJSON(Object=accessjson, AddressString="node")
accessjson_3 = AccessJSON(Object=accessjson, AddressString="edge")
item = ListItem(Index=0, Wrap=True)  # -> Item, Item1
expression = Expression(Expression="x=\"Polygon\"")
pt = ConstructPoint(XCoordinate=item.Item, YCoordinate=item.Item1, ZCoordinate=0)
accessjson_4 = AccessJSON(Object=accessjson_2, AddressString="properties")
accessjson_5 = AccessJSON(Object=accessjson_3, AddressString="properties")
pline = PolyLine(Vertices=flatten(pt), Closed=expression)
accessjson_6 = AccessJSON(Object=accessjson_4, AddressString="metadata")
accessjson_7 = AccessJSON(Object=accessjson_5, AddressString="source")
panel = Panel(accessjson_7)
accessjson_8 = AccessJSON(Object=accessjson_6, AddressString="geometry")
accessjson_9 = AccessJSON(Object=accessjson_8, AddressString="coordinates")
panel_2 = Panel(accessjson_8)
item_2 = ListItem(List=accessjson_9, Index=0, Wrap=True)  # -> Item, Item1, Item2
pt_2 = ConstructPoint(XCoordinate=item_2.Item, YCoordinate=item_2.Item1, ZCoordinate=item_2.Item2)
