# Grasshopper definition loadJSON.gh (Grasshopper 1.0.7)
# plug-ins: ShapeDiverForGrasshopper, Pufferfish

# JSONfrontend.txt
path = FilePath("D:\IAAC\04_Thesis\CloudBasedGraphMachineLearningFrontend\backup\JSONfrontend.txt")
# JSONbackend.txt
path_2 = FilePath("D:\IAAC\04_Thesis\CloudBasedGraphMachineLearningFrontend\backup\JSONbackend.txt")
# JSONfromGH.txt
path_3 = FilePath("D:\IAAC\04_Thesis\CloudBasedGraphMachineLearningFrontend\backup\JSONfromGH.txt")
file = ReadFile(File=path_2, PerLineParse=False)
file_2 = ReadFile(File=path_3, PerLineParse=False)
file_3 = ReadFile(File=path, PerLineParse=False)
parsejson = ParseJSON(JSON=file)
parsejson_2 = ParseJSON(JSON=file_2)
parsejson_3 = ParseJSON(JSON=file_3)
accessjson = AccessJSON(Object=parsejson, AddressString="features")
accessjson_2 = AccessJSON(Object=parsejson_2, AddressString="features")
accessjson_3 = AccessJSON(Object=parsejson_3, AddressString="geometry")
accessjson_4 = AccessJSON(Object=accessjson, AddressString="node")
accessjson_5 = AccessJSON(Object=accessjson, AddressString="edge")
accessjson_6 = AccessJSON(Object=accessjson_2, AddressString="node")
accessjson_7 = AccessJSON(Object=accessjson_2, AddressString="edge")
accessjson_8 = AccessJSON(Object=accessjson_3, AddressString="coordinates")
accessjson_9 = AccessJSON(Object=accessjson_3, AddressString="type")
null = NullItem(Item=accessjson_5)  # -> NullFlags, InvalidFlags, Description
null_2 = NullItem(Item=accessjson_7)  # -> NullFlags, InvalidFlags, Description
panel = Panel(accessjson_8)
data = Data(Tree({0;0;0}: [-12.08129629, 78.75215361], {0;0;1}: [-64.43358023, -3.132187928], {0;0;2}: [-21.47786008, -50.56246226], {0;0;3}: [-3.579643346, -52.35228393], {0;0;4}: [53.24719477, 1.342366255], {0;0;5}: [48.32518517, 25.95241426]))
expression = Expression(x=accessjson_9, Expression="x=\"Polygon\"")
item = ListItem(List=accessjson_8, Index=0, Wrap=True)  # -> Item, Item1, Item2
accessjson_10 = AccessJSON(Object=accessjson_4, AddressString="properties")
accessjson_11 = AccessJSON(Object=accessjson_6, AddressString="properties")
dispdexs = DispatchIndices(List=accessjson_5, Indices=null.NullFlags)  # -> AtI, NotI
dispdexs_2 = DispatchIndices(List=accessjson_7, Indices=null_2.NullFlags)  # -> AtI, NotI
pt = ConstructPoint(XCoordinate=item.Item, YCoordinate=item.Item1, ZCoordinate=0)
accessjson_12 = AccessJSON(Object=accessjson_10, AddressString="metadata")
accessjson_13 = AccessJSON(Object=accessjson_11, AddressString="metadata")
accessjson_14 = AccessJSON(Object=dispdexs.AtI, AddressString="properties")
accessjson_15 = AccessJSON(Object=dispdexs_2.AtI, AddressString="properties")
pline = PolyLine(Vertices=flatten(pt), Closed=expression)
accessjson_16 = AccessJSON(Object=accessjson_12, AddressString="geometry")
accessjson_17 = AccessJSON(Object=accessjson_13, AddressString="geometry")
accessjson_18 = AccessJSON(Object=accessjson_16, AddressString="coordinates")
accessjson_19 = AccessJSON(Object=accessjson_14, AddressString="source")
accessjson_20 = AccessJSON(Object=accessjson_14, AddressString="target")
accessjson_21 = AccessJSON(Object=accessjson_17, AddressString="coordinates")
accessjson_22 = AccessJSON(Object=accessjson_15, AddressString="source")
accessjson_23 = AccessJSON(Object=accessjson_15, AddressString="target")
item_2 = ListItem(List=accessjson_18, Index=0, Wrap=True)  # -> Item, Item1, Item2
item_3 = ListItem(List=accessjson_21, Index=0, Wrap=True)  # -> Item, Item1, Item2
pt_2 = ConstructPoint(XCoordinate=item_2.Item, YCoordinate=item_2.Item1, ZCoordinate=item_2.Item2)
pt_3 = ConstructPoint(XCoordinate=item_3.Item, YCoordinate=item_3.Item1, ZCoordinate=item_3.Item2)
item_4 = ListItem(List=flatten(pt_2), Index=accessjson_19, Wrap=True)
item_5 = ListItem(List=flatten(pt_2), Index=accessjson_20, Wrap=True)
item_6 = ListItem(List=flatten(pt_3), Index=accessjson_22, Wrap=True)
item_7 = ListItem(List=flatten(pt_3), Index=accessjson_23, Wrap=True)
ln = Line(StartPoint=item_4, EndPoint=item_5)
ln_2 = Line(StartPoint=item_6, EndPoint=item_7)
pt_4 = Point(pt_3)
crv = Curve(pline)
pt_5 = Point(pt_2)
